# Grasshopper definition GenerateCase.gh (Grasshopper 1.0.7)
# plug-ins: Pufferfish, Human

output_directory = Panel("C:\Users\tgerrish\Desktop\_0Ghadan21")
weatherfile = Panel("C:\Users\tgerrish\Documents\GitHub\oshe\projects\UWG_ARE_AZ_Abu.Dhabi-Bateen.Exec.AP.412160_TMYx_URBAN_02.epw")
material = Panel("""BDG_CONTEXT
MediumRough
0.2032
1.95
2240
900
0.9
0.7
0""")
refreshall = Button()
material_2 = Panel("""GND_SURROUNDING
MediumRough
0.2
1.73
2243
837
0.9
0.65
0""")
ladybug = Ladybug_Ladybug()  # -> Vviiiiiiiiiizzz; plug-in component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
honeybee = Honeybee_Honeybee()  # -> Vviiiiiiiiiizzz; plug-in component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
material_3 = Panel("""GND_CONCRETEDARK
MediumRough
0.2
1.73
2243
837
0.9
0.7
0""")
material_4 = Panel("""GND_CONCRETELIGHT
MediumRough
0.2
1.73
2243
837
0.9
0.65
0""")
material_5 = Panel("""GND_VEGETATION
Rough
0.2
1
1250
1252
0.92
0.75
0""")
material_6 = Panel("""GND_SAND
Rough
0.2
1.25
2100
810
0.88
0.7
0""")
material_7 = Panel("""GND_WOOD
MediumSmooth
0.1
0.167
680
1630
0.9
0.7
0""")
material_8 = Panel("""GND_STONEDARK
MediumRough
0.2
2
2243
790
0.9
0.7
0""")
material_9 = Panel("""GND_GRASS
Rough
0.2
1
1250
1252
0.92
0.75
0""")
material_10 = Panel("""GND_WATER
MediumRough
0.2
1.4
1840
1480
0.95
0.8
0""")
material_11 = Panel("""GND_STONE
MediumRough
0.2
2
2243
790
0.9
0.55
0""")
e_executable_path = Panel("C:\openstudio-2.9.0\EnergyPlus\energyplus.exe")
material_12 = Panel("""GND_ASPHALT
MediumRough
0.2
0.75
2360
920
0.93
0.87
0""")
material_13 = Panel("""VEG_GHAF
VeryRough
0.05
0.01
0.5
150
0.9
0.7
0.15""")
material_14 = Panel("""SHD_SOLID
MediumRough
0.102
0.12
320
795
0.9
0.7
0""")
material_15 = Panel("""SHD_FABRIC
MediumRough
0.102
0.12
320
795
0.9
0.7
0.15""")
toplayer = Data("FAMILYPARK1")

# ---- group: CONTEXT BUILDING MASSES
python = GhPythonScript(Refresh=refreshall, MaterialPanel=material)  # -> LayerName, Roughness, Thickness, Conductivity, Density, SpecificHeat, ThermalAbsorptivity, SolarAbsorptivity, Porosity; inputs Refresh: Boolean, MaterialPanel: list
# ---------- python: Python ----------
if Refresh:
    pass

LayerName = str(MaterialPanel[0])
Roughness = str(MaterialPanel[1])
Thickness = float(MaterialPanel[2])
Conductivity = float(MaterialPanel[3])
Density = float(MaterialPanel[4])
SpecificHeat = float(MaterialPanel[5])
ThermalAbsorptivity = float(MaterialPanel[6])
SolarAbsorptivity = float(MaterialPanel[7])
Porosity = float(MaterialPanel[8])
# ---------- end python ----------
cluster = Cluster_3(solarabsorptivity=python.SolarAbsorptivity)
cluster_2 = Cluster_4(toplayer=toplayer, layername=python.LayerName)  # -> brep_2, brepnames_2
epopaquemat = Honeybee_EnergyPlusOpaqueMaterial(
    name=python.LayerName,
    roughness=python.Roughness,
    thickness=python.Thickness,
    conductivity=python.Conductivity,
    density=python.Density,
    specificHeat=python.SpecificHeat,
    thermAbsp=python.ThermalAbsorptivity,
    solAbsp=python.SolarAbsorptivity,
    visAbsp=python.SolarAbsorptivity)  # -> EPMaterial; plug-in component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
debrep = DeconstructBrep(Brep=cluster_2.brep_2)  # -> flatten(Faces), Edges, Vertices
mass2zone = Honeybee_Masses2Zones(zoneMasses=flatten(cluster_2.brep_2), zoneNames=cluster_2.brepnames_2, maxRoofAngle=30, createHBZones=Toggle(True))  # -> readMe, HBZones; plug-in component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
epconstruction = Honeybee_EnergyPlusConstruction(name=python.LayerName, layer_1=epopaquemat)  # -> EPConstruction; plug-in component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
radopaquemat = HoneybeePlus_RadianceOpaqueMaterial(name=graft(python.LayerName), reflect=graft(cluster), spec=0, rough=0)  # -> simplify(material); plug-in component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
lng = ListLength(List=debrep.Faces)
series = Series(Start=0, Step=1, Count=lng)
concat = Concatenate(FragmentA=python.LayerName, FragmentB=series)
setepzonecnstr = Honeybee_SetEPZoneConstruction(
    HBZones=flatten(mass2zone.HBZones),
    wallEPConstruction=epconstruction,
    roofEPConstruction=epconstruction,
    floorEPConstruction=epconstruction,
    expFloorEPConstruction=epconstruction)  # -> simplify(modifiedHBZones); plug-in component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
hbsurface = HoneybeePlus_HoneybeeSurface(geo=debrep.Faces, names=concat, type="0", rad_mat=radopaquemat)  # -> report, flatten(HB_srf); plug-in component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
hbzones_energyplus = Data(flatten(setepzonecnstr))
hb_srfs_radiance = Data(flatten(hbsurface.HB_srf))

# ---- group: GROUND SURFACES
python_2 = GhPythonScript(Refresh=refreshall, MaterialPanel=material_2)  # -> LayerName, Roughness, Thickness, Conductivity, Density, SpecificHeat, ThermalAbsorptivity, SolarAbsorptivity, Porosity; inputs Refresh: Boolean, MaterialPanel: list; same code as python
epopaquemat_2 = Honeybee_EnergyPlusOpaqueMaterial(
    name=python_2.LayerName,
    roughness=python_2.Roughness,
    thickness=python_2.Thickness,
    conductivity=python_2.Conductivity,
    density=python_2.Density,
    specificHeat=python_2.SpecificHeat,
    thermAbsp=python_2.ThermalAbsorptivity,
    solAbsp=python_2.SolarAbsorptivity,
    visAbsp=python_2.SolarAbsorptivity)  # -> EPMaterial; plug-in component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
cluster_3 = Cluster(toplayer=toplayer, layername=python_2.LayerName)  # -> surfaces_2, surfacenames_2
radopaquemat_2 = HoneybeePlus_RadianceOpaqueMaterial(name=graft(python_2.LayerName), reflect=graft(0.35), spec=0, rough=0)  # -> simplify(material); plug-in component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
epconstruction_2 = Honeybee_EnergyPlusConstruction(name=python_2.LayerName, layer_1=epopaquemat_2)  # -> EPConstruction; plug-in component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
createhbsrfs = Honeybee_createHBSrfs(geometry=cluster_3.surfaces_2, srfName=cluster_3.surfacenames_2, srfType="2", EPConstruction=epconstruction_2)  # -> readMe, simplify(flatten(HBSurface)); plug-in component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
hbsurface_2 = HoneybeePlus_HoneybeeSurface(geo=cluster_3.surfaces_2, names=cluster_3.surfacenames_2, type="2", rad_mat=radopaquemat_2)  # -> report, flatten(HB_srf); plug-in component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
hbsrfs_energyplus = Data(flatten(createhbsrfs.HBSurface))
hb_srfs_radiance_2 = Data(flatten(hbsurface_2.HB_srf))

python_3 = GhPythonScript(Refresh=refreshall, MaterialPanel=material_6)  # -> LayerName, Roughness, Thickness, Conductivity, Density, SpecificHeat, ThermalAbsorptivity, SolarAbsorptivity, Porosity; inputs Refresh: Boolean, MaterialPanel: list; same code as python
cluster_4 = Cluster_3(solarabsorptivity=python_3.SolarAbsorptivity)
cluster_5 = Cluster(toplayer=toplayer, layername=python_3.LayerName)  # -> surfaces_2, surfacenames_2
epopaquemat_3 = Honeybee_EnergyPlusOpaqueMaterial(
    name=python_3.LayerName,
    roughness=python_3.Roughness,
    thickness=python_3.Thickness,
    conductivity=python_3.Conductivity,
    density=python_3.Density,
    specificHeat=python_3.SpecificHeat,
    thermAbsp=python_3.ThermalAbsorptivity,
    solAbsp=python_3.SolarAbsorptivity,
    visAbsp=python_3.SolarAbsorptivity)  # -> EPMaterial; plug-in component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
epconstruction_3 = Honeybee_EnergyPlusConstruction(name=python_3.LayerName, layer_1=epopaquemat_3)  # -> EPConstruction; plug-in component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
radopaquemat_3 = HoneybeePlus_RadianceOpaqueMaterial(name=graft(python_3.LayerName), reflect=graft(cluster_4), spec=0, rough=0)  # -> simplify(material); plug-in component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
cluster_6 = Cluster_2(surfaces=cluster_5.surfaces_2)
createhbsrfs_2 = Honeybee_createHBSrfs(geometry=cluster_5.surfaces_2, srfName=cluster_5.surfacenames_2, srfType="1", EPConstruction=epconstruction_3)  # -> readMe, simplify(flatten(HBSurface)); plug-in component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
hbsurface_3 = HoneybeePlus_HoneybeeSurface(geo=cluster_5.surfaces_2, names=cluster_5.surfacenames_2, type="1", rad_mat=radopaquemat_3)  # -> report, flatten(HB_srf); plug-in component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
hbsrfs_energyplus_2 = Data(flatten(createhbsrfs_2.HBSurface))
hb_srfs_radiance_3 = Data(flatten(hbsurface_3.HB_srf))
boundaries = Data(flatten(cluster_6))
reflectivity = Data(flatten(cluster_4))

python_4 = GhPythonScript(Refresh=refreshall, MaterialPanel=material_7)  # -> LayerName, Roughness, Thickness, Conductivity, Density, SpecificHeat, ThermalAbsorptivity, SolarAbsorptivity, Porosity; inputs Refresh: Boolean, MaterialPanel: list; same code as python
cluster_7 = Cluster_3(solarabsorptivity=python_4.SolarAbsorptivity)
cluster_8 = Cluster(toplayer=toplayer, layername=python_4.LayerName)  # -> surfaces_2, surfacenames_2
epopaquemat_4 = Honeybee_EnergyPlusOpaqueMaterial(
    name=python_4.LayerName,
    roughness=python_4.Roughness,
    thickness=python_4.Thickness,
    conductivity=python_4.Conductivity,
    density=python_4.Density,
    specificHeat=python_4.SpecificHeat,
    thermAbsp=python_4.ThermalAbsorptivity,
    solAbsp=python_4.SolarAbsorptivity,
    visAbsp=python_4.SolarAbsorptivity)  # -> EPMaterial; plug-in component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
radopaquemat_4 = HoneybeePlus_RadianceOpaqueMaterial(name=graft(python_4.LayerName), reflect=graft(cluster_7), spec=0, rough=0)  # -> simplify(material); plug-in component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
epconstruction_4 = Honeybee_EnergyPlusConstruction(name=python_4.LayerName, layer_1=epopaquemat_4)  # -> EPConstruction; plug-in component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
cluster_9 = Cluster_2(surfaces=cluster_8.surfaces_2)
createhbsrfs_3 = Honeybee_createHBSrfs(geometry=cluster_8.surfaces_2, srfName=cluster_8.surfacenames_2, srfType="1", EPConstruction=epconstruction_4)  # -> readMe, simplify(flatten(HBSurface)); plug-in component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
hbsurface_4 = HoneybeePlus_HoneybeeSurface(geo=cluster_8.surfaces_2, names=cluster_8.surfacenames_2, type="1", rad_mat=radopaquemat_4)  # -> report, flatten(HB_srf); plug-in component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
hbsrfs_energyplus_3 = Data(flatten(createhbsrfs_3.HBSurface))
hb_srfs_radiance_4 = Data(flatten(hbsurface_4.HB_srf))
boundaries_2 = Data(flatten(cluster_9))
reflectivity_2 = Data(flatten(cluster_7))

python_5 = GhPythonScript(Refresh=refreshall, MaterialPanel=material_8)  # -> LayerName, Roughness, Thickness, Conductivity, Density, SpecificHeat, ThermalAbsorptivity, SolarAbsorptivity, Porosity; inputs Refresh: Boolean, MaterialPanel: list; same code as python
cluster_10 = Cluster_3(solarabsorptivity=python_5.SolarAbsorptivity)
cluster_11 = Cluster(toplayer=toplayer, layername=python_5.LayerName)  # -> surfaces_2, surfacenames_2
epopaquemat_5 = Honeybee_EnergyPlusOpaqueMaterial(
    name=python_5.LayerName,
    roughness=python_5.Roughness,
    thickness=python_5.Thickness,
    conductivity=python_5.Conductivity,
    density=python_5.Density,
    specificHeat=python_5.SpecificHeat,
    thermAbsp=python_5.ThermalAbsorptivity,
    solAbsp=python_5.SolarAbsorptivity,
    visAbsp=python_5.SolarAbsorptivity)  # -> EPMaterial; plug-in component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
radopaquemat_5 = HoneybeePlus_RadianceOpaqueMaterial(name=graft(python_5.LayerName), reflect=graft(cluster_10), spec=0, rough=0)  # -> simplify(material); plug-in component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
epconstruction_5 = Honeybee_EnergyPlusConstruction(name=python_5.LayerName, layer_1=epopaquemat_5)  # -> EPConstruction; plug-in component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
cluster_12 = Cluster_2(surfaces=cluster_11.surfaces_2)
createhbsrfs_4 = Honeybee_createHBSrfs(geometry=cluster_11.surfaces_2, srfName=cluster_11.surfacenames_2, srfType="1", EPConstruction=epconstruction_5)  # -> readMe, simplify(flatten(HBSurface)); plug-in component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
hbsurface_5 = HoneybeePlus_HoneybeeSurface(geo=cluster_11.surfaces_2, names=cluster_11.surfacenames_2, type="1", rad_mat=radopaquemat_5)  # -> report, flatten(HB_srf); plug-in component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
hbsrfs_energyplus_4 = Data(flatten(createhbsrfs_4.HBSurface))
hb_srfs_radiance_5 = Data(flatten(hbsurface_5.HB_srf))
boundaries_3 = Data(flatten(cluster_12))
reflectivity_3 = Data(flatten(cluster_10))

python_6 = GhPythonScript(Refresh=refreshall, MaterialPanel=material_3)  # -> LayerName, Roughness, Thickness, Conductivity, Density, SpecificHeat, ThermalAbsorptivity, SolarAbsorptivity, Porosity; inputs Refresh: Boolean, MaterialPanel: list; same code as python
cluster_13 = Cluster_3(solarabsorptivity=python_6.SolarAbsorptivity)
cluster_14 = Cluster(toplayer=toplayer, layername=python_6.LayerName)  # -> surfaces_2, surfacenames_2
epopaquemat_6 = Honeybee_EnergyPlusOpaqueMaterial(
    name=python_6.LayerName,
    roughness=python_6.Roughness,
    thickness=python_6.Thickness,
    conductivity=python_6.Conductivity,
    density=python_6.Density,
    specificHeat=python_6.SpecificHeat,
    thermAbsp=python_6.ThermalAbsorptivity,
    solAbsp=python_6.SolarAbsorptivity,
    visAbsp=python_6.SolarAbsorptivity)  # -> EPMaterial; plug-in component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
radopaquemat_6 = HoneybeePlus_RadianceOpaqueMaterial(name=graft(python_6.LayerName), reflect=graft(cluster_13), spec=0, rough=0)  # -> simplify(material); plug-in component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
epconstruction_6 = Honeybee_EnergyPlusConstruction(name=python_6.LayerName, layer_1=epopaquemat_6)  # -> EPConstruction; plug-in component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
cluster_15 = Cluster_2(surfaces=cluster_14.surfaces_2)
createhbsrfs_5 = Honeybee_createHBSrfs(geometry=cluster_14.surfaces_2, srfName=cluster_14.surfacenames_2, srfType="1", EPConstruction=epconstruction_6)  # -> readMe, simplify(flatten(HBSurface)); plug-in component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
hbsurface_6 = HoneybeePlus_HoneybeeSurface(geo=cluster_14.surfaces_2, names=cluster_14.surfacenames_2, type="1", rad_mat=radopaquemat_6)  # -> report, flatten(HB_srf); plug-in component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
hbsrfs_energyplus_5 = Data(flatten(createhbsrfs_5.HBSurface))
hb_srfs_radiance_6 = Data(flatten(hbsurface_6.HB_srf))
boundaries_4 = Data(flatten(cluster_15))
reflectivity_4 = Data(flatten(cluster_13))

python_7 = GhPythonScript(Refresh=refreshall, MaterialPanel=material_4)  # -> LayerName, Roughness, Thickness, Conductivity, Density, SpecificHeat, ThermalAbsorptivity, SolarAbsorptivity, Porosity; inputs Refresh: Boolean, MaterialPanel: list; same code as python
cluster_16 = Cluster_3(solarabsorptivity=python_7.SolarAbsorptivity)
cluster_17 = Cluster(toplayer=toplayer, layername=python_7.LayerName)  # -> surfaces_2, surfacenames_2
epopaquemat_7 = Honeybee_EnergyPlusOpaqueMaterial(
    name=python_7.LayerName,
    roughness=python_7.Roughness,
    thickness=python_7.Thickness,
    conductivity=python_7.Conductivity,
    density=python_7.Density,
    specificHeat=python_7.SpecificHeat,
    thermAbsp=python_7.ThermalAbsorptivity,
    solAbsp=python_7.SolarAbsorptivity,
    visAbsp=python_7.SolarAbsorptivity)  # -> EPMaterial; plug-in component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
epconstruction_7 = Honeybee_EnergyPlusConstruction(name=python_7.LayerName, layer_1=epopaquemat_7)  # -> EPConstruction; plug-in component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
radopaquemat_7 = HoneybeePlus_RadianceOpaqueMaterial(name=graft(python_7.LayerName), reflect=graft(cluster_16), spec=0, rough=0)  # -> simplify(material); plug-in component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
cluster_18 = Cluster_2(surfaces=cluster_17.surfaces_2)
createhbsrfs_6 = Honeybee_createHBSrfs(geometry=cluster_17.surfaces_2, srfName=cluster_17.surfacenames_2, srfType="1", EPConstruction=epconstruction_7)  # -> readMe, simplify(flatten(HBSurface)); plug-in component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
hbsurface_7 = HoneybeePlus_HoneybeeSurface(geo=cluster_17.surfaces_2, names=cluster_17.surfacenames_2, type="1", rad_mat=radopaquemat_7)  # -> report, flatten(HB_srf); plug-in component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
hbsrfs_energyplus_6 = Data(flatten(createhbsrfs_6.HBSurface))
hb_srfs_radiance_7 = Data(flatten(hbsurface_7.HB_srf))
boundaries_5 = Data(flatten(cluster_18))
reflectivity_5 = Data(flatten(cluster_16))

python_8 = GhPythonScript(Refresh=refreshall, MaterialPanel=material_12)  # -> LayerName, Roughness, Thickness, Conductivity, Density, SpecificHeat, ThermalAbsorptivity, SolarAbsorptivity, Porosity; inputs Refresh: Boolean, MaterialPanel: list; same code as python
cluster_19 = Cluster_3(solarabsorptivity=python_8.SolarAbsorptivity)
cluster_20 = Cluster(toplayer=toplayer, layername=python_8.LayerName)  # -> surfaces_2, surfacenames_2
epopaquemat_8 = Honeybee_EnergyPlusOpaqueMaterial(
    name=python_8.LayerName,
    roughness=python_8.Roughness,
    thickness=python_8.Thickness,
    conductivity=python_8.Conductivity,
    density=python_8.Density,
    specificHeat=python_8.SpecificHeat,
    thermAbsp=python_8.ThermalAbsorptivity,
    solAbsp=python_8.SolarAbsorptivity,
    visAbsp=python_8.SolarAbsorptivity)  # -> EPMaterial; plug-in component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
radopaquemat_8 = HoneybeePlus_RadianceOpaqueMaterial(name=graft(python_8.LayerName), reflect=graft(cluster_19), spec=0, rough=0)  # -> simplify(material); plug-in component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
cluster_21 = Cluster_2(surfaces=cluster_20.surfaces_2)
epconstruction_8 = Honeybee_EnergyPlusConstruction(name=python_8.LayerName, layer_1=epopaquemat_8)  # -> EPConstruction; plug-in component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
createhbsrfs_7 = Honeybee_createHBSrfs(geometry=cluster_20.surfaces_2, srfName=cluster_20.surfacenames_2, srfType="1", EPConstruction=epconstruction_8)  # -> readMe, simplify(flatten(HBSurface)); plug-in component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
hbsurface_8 = HoneybeePlus_HoneybeeSurface(geo=cluster_20.surfaces_2, names=cluster_20.surfacenames_2, type="1", rad_mat=radopaquemat_8)  # -> report, flatten(HB_srf); plug-in component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
hbsrfs_energyplus_7 = Data(flatten(createhbsrfs_7.HBSurface))
hb_srfs_radiance_8 = Data(flatten(hbsurface_8.HB_srf))
boundaries_6 = Data(flatten(cluster_21))
reflectivity_6 = Data(flatten(cluster_19))

python_9 = GhPythonScript(Refresh=refreshall, MaterialPanel=material_10)  # -> LayerName, Roughness, Thickness, Conductivity, Density, SpecificHeat, ThermalAbsorptivity, SolarAbsorptivity, Porosity; inputs Refresh: Boolean, MaterialPanel: list; same code as python
cluster_22 = Cluster_3(solarabsorptivity=python_9.SolarAbsorptivity)
cluster_23 = Cluster(toplayer=toplayer, layername=python_9.LayerName)  # -> surfaces_2, surfacenames_2
epopaquemat_9 = Honeybee_EnergyPlusOpaqueMaterial(
    name=python_9.LayerName,
    roughness=python_9.Roughness,
    thickness=python_9.Thickness,
    conductivity=python_9.Conductivity,
    density=python_9.Density,
    specificHeat=python_9.SpecificHeat,
    thermAbsp=python_9.ThermalAbsorptivity,
    solAbsp=python_9.SolarAbsorptivity,
    visAbsp=python_9.SolarAbsorptivity)  # -> EPMaterial; plug-in component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
epconstruction_9 = Honeybee_EnergyPlusConstruction(name=python_9.LayerName, layer_1=epopaquemat_9)  # -> EPConstruction; plug-in component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
radopaquemat_9 = HoneybeePlus_RadianceOpaqueMaterial(name=graft(python_9.LayerName), reflect=graft(cluster_22), spec=0, rough=0)  # -> simplify(material); plug-in component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
cluster_24 = Cluster_2(surfaces=cluster_23.surfaces_2)
createhbsrfs_8 = Honeybee_createHBSrfs(geometry=cluster_23.surfaces_2, srfName=cluster_23.surfacenames_2, srfType="1", EPConstruction=epconstruction_9)  # -> readMe, simplify(flatten(HBSurface)); plug-in component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
hbsurface_9 = HoneybeePlus_HoneybeeSurface(geo=cluster_23.surfaces_2, names=cluster_23.surfacenames_2, type="1", rad_mat=radopaquemat_9)  # -> report, flatten(HB_srf); plug-in component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
hbsrfs_energyplus_8 = Data(flatten(createhbsrfs_8.HBSurface))
hb_srfs_radiance_9 = Data(flatten(hbsurface_9.HB_srf))
boundaries_7 = Data(flatten(cluster_24))
reflectivity_7 = Data(flatten(cluster_22))

python_10 = GhPythonScript(Refresh=refreshall, MaterialPanel=material_11)  # -> LayerName, Roughness, Thickness, Conductivity, Density, SpecificHeat, ThermalAbsorptivity, SolarAbsorptivity, Porosity; inputs Refresh: Boolean, MaterialPanel: list; same code as python
cluster_25 = Cluster_3(solarabsorptivity=python_10.SolarAbsorptivity)
cluster_26 = Cluster(toplayer=toplayer, layername=python_10.LayerName)  # -> surfaces_2, surfacenames_2
epopaquemat_10 = Honeybee_EnergyPlusOpaqueMaterial(
    name=python_10.LayerName,
    roughness=python_10.Roughness,
    thickness=python_10.Thickness,
    conductivity=python_10.Conductivity,
    density=python_10.Density,
    specificHeat=python_10.SpecificHeat,
    thermAbsp=python_10.ThermalAbsorptivity,
    solAbsp=python_10.SolarAbsorptivity,
    visAbsp=python_10.SolarAbsorptivity)  # -> EPMaterial; plug-in component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
radopaquemat_10 = HoneybeePlus_RadianceOpaqueMaterial(name=graft(python_10.LayerName), reflect=graft(cluster_25), spec=0, rough=0)  # -> simplify(material); plug-in component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
epconstruction_10 = Honeybee_EnergyPlusConstruction(name=python_10.LayerName, layer_1=epopaquemat_10)  # -> EPConstruction; plug-in component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
cluster_27 = Cluster_2(surfaces=cluster_26.surfaces_2)
createhbsrfs_9 = Honeybee_createHBSrfs(geometry=cluster_26.surfaces_2, srfName=cluster_26.surfacenames_2, srfType="1", EPConstruction=epconstruction_10)  # -> readMe, simplify(flatten(HBSurface)); plug-in component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
hbsurface_10 = HoneybeePlus_HoneybeeSurface(geo=cluster_26.surfaces_2, names=cluster_26.surfacenames_2, type="1", rad_mat=radopaquemat_10)  # -> report, flatten(HB_srf); plug-in component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
hbsrfs_energyplus_9 = Data(flatten(createhbsrfs_9.HBSurface))
hb_srfs_radiance_10 = Data(flatten(hbsurface_10.HB_srf))
boundaries_8 = Data(flatten(cluster_27))
reflectivity_8 = Data(flatten(cluster_25))

python_11 = GhPythonScript(Refresh=refreshall, MaterialPanel=material_5)  # -> LayerName, Roughness, Thickness, Conductivity, Density, SpecificHeat, ThermalAbsorptivity, SolarAbsorptivity, Porosity; inputs Refresh: Boolean, MaterialPanel: list; same code as python
cluster_28 = Cluster_3(solarabsorptivity=python_11.SolarAbsorptivity)
cluster_29 = Cluster(toplayer=toplayer, layername=python_11.LayerName)  # -> surfaces_2, surfacenames_2
epopaquemat_11 = Honeybee_EnergyPlusOpaqueMaterial(
    name=python_11.LayerName,
    roughness=python_11.Roughness,
    thickness=python_11.Thickness,
    conductivity=python_11.Conductivity,
    density=python_11.Density,
    specificHeat=python_11.SpecificHeat,
    thermAbsp=python_11.ThermalAbsorptivity,
    solAbsp=python_11.SolarAbsorptivity,
    visAbsp=python_11.SolarAbsorptivity)  # -> EPMaterial; plug-in component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
epconstruction_11 = Honeybee_EnergyPlusConstruction(name=python_11.LayerName, layer_1=epopaquemat_11)  # -> EPConstruction; plug-in component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
radopaquemat_11 = HoneybeePlus_RadianceOpaqueMaterial(name=graft(python_11.LayerName), reflect=graft(cluster_28), spec=0, rough=0)  # -> simplify(material); plug-in component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
cluster_30 = Cluster_2(surfaces=cluster_29.surfaces_2)
createhbsrfs_10 = Honeybee_createHBSrfs(geometry=cluster_29.surfaces_2, srfName=cluster_29.surfacenames_2, srfType="1", EPConstruction=epconstruction_11)  # -> readMe, simplify(flatten(HBSurface)); plug-in component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
hbsurface_11 = HoneybeePlus_HoneybeeSurface(geo=cluster_29.surfaces_2, names=cluster_29.surfacenames_2, type="1", rad_mat=radopaquemat_11)  # -> report, flatten(HB_srf); plug-in component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
hbsrfs_energyplus_10 = Data(flatten(createhbsrfs_10.HBSurface))
hb_srfs_radiance_11 = Data(flatten(hbsurface_11.HB_srf))
boundaries_9 = Data(flatten(cluster_30))
reflectivity_9 = Data(flatten(cluster_28))

python_12 = GhPythonScript(Refresh=refreshall, MaterialPanel=material_9)  # -> LayerName, Roughness, Thickness, Conductivity, Density, SpecificHeat, ThermalAbsorptivity, SolarAbsorptivity, Porosity; inputs Refresh: Boolean, MaterialPanel: list; same code as python
cluster_31 = Cluster_3(solarabsorptivity=python_12.SolarAbsorptivity)
cluster_32 = Cluster(toplayer=toplayer, layername=python_12.LayerName)  # -> surfaces_2, surfacenames_2
epopaquemat_12 = Honeybee_EnergyPlusOpaqueMaterial(
    name=python_12.LayerName,
    roughness=python_12.Roughness,
    thickness=python_12.Thickness,
    conductivity=python_12.Conductivity,
    density=python_12.Density,
    specificHeat=python_12.SpecificHeat,
    thermAbsp=python_12.ThermalAbsorptivity,
    solAbsp=python_12.SolarAbsorptivity,
    visAbsp=python_12.SolarAbsorptivity)  # -> EPMaterial; plug-in component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
epconstruction_12 = Honeybee_EnergyPlusConstruction(name=python_12.LayerName, layer_1=epopaquemat_12)  # -> EPConstruction; plug-in component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
radopaquemat_12 = HoneybeePlus_RadianceOpaqueMaterial(name=graft(python_12.LayerName), reflect=graft(cluster_31), spec=0, rough=0)  # -> simplify(material); plug-in component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
cluster_33 = Cluster_2(surfaces=cluster_32.surfaces_2)
createhbsrfs_11 = Honeybee_createHBSrfs(geometry=cluster_32.surfaces_2, srfName=cluster_32.surfacenames_2, srfType="1", EPConstruction=epconstruction_12)  # -> readMe, simplify(flatten(HBSurface)); plug-in component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
hbsurface_12 = HoneybeePlus_HoneybeeSurface(geo=cluster_32.surfaces_2, names=cluster_32.surfacenames_2, type="1", rad_mat=radopaquemat_12)  # -> report, flatten(HB_srf); plug-in component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
hbsrfs_energyplus_11 = Data(flatten(createhbsrfs_11.HBSurface))
hb_srfs_radiance_12 = Data(flatten(hbsurface_12.HB_srf))
boundaries_10 = Data(flatten(cluster_33))
reflectivity_10 = Data(flatten(cluster_31))

# ---- group: SHADING SURFACES
python_13 = GhPythonScript(Refresh=refreshall, MaterialPanel=material_15)  # -> LayerName, Roughness, Thickness, Conductivity, Density, SpecificHeat, ThermalAbsorptivity, SolarAbsorptivity, Porosity; inputs Refresh: Boolean, MaterialPanel: list; same code as python
constantschedule = Honeybee_ConstantSchedule(value=python_13.Porosity, scheduleName=python_13.LayerName)  # -> readMe, schedule, weekSched, schedIDFText; plug-in component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
radglassmaterial = Honeybee_RadianceGlassMaterial(
    materialName=python_13.LayerName,
    RTransmittance=python_13.Porosity,
    GTransmittance=python_13.Porosity,
    BTransmittance=python_13.Porosity,
    refractiveIndex=1.52)  # -> avrgTrans, RADMaterial; plug-in component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
cluster_34 = Cluster(toplayer=toplayer, layername=python_13.LayerName)  # -> surfaces_2, surfacenames_2
radglassmat = HoneybeePlus_RadianceGlassMaterial(name=python_13.LayerName, t_vis=python_13.Porosity)  # -> material; plug-in component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
hb_epcontextsrf = HoneybeeEPContextSurfaces(
    shdSurfaces=flatten(cluster_34.surfaces_2),
    EPTransSchedule=constantschedule.schedule,
    RADMaterial=radglassmaterial.RADMaterial)  # -> HBContext; inputs shdSurfaces: list of Brep, justBoundingBox: Boolean
# ---------- hb_epcontextsrf: Python ----------
"""
prepare shading/context geometries

    Args:
        northVectorOrRotation: A vector that shows North or a number that shows
                               the rotation of the North from the Y axis
        bldgMasses: List of closed Breps as thermal zones.
    Returns:
        report: ...
        thermalZones: Thermal zone's geometries for visualiza
"""

ghenv.Component.Name = 'Honeybee EP context Surfaces'
ghenv.Component.NickName = 'HB_EPContextSrf'
ghenv.Component.Message = 'VER 0.0.65\nFEB_06_2020'
ghenv.Component.IconDisplayMode = ghenv.Component.IconDisplayMode.application
ghenv.Component.Category = 'HB-Legacy'
ghenv.Component.SubCategory = "10 | Energy | Energy"
#compatibleHBVersion = VER 0.0.57\nNOV_04_2016
#compatibleLBVersion = VER 0.0.59\nFEB_01_2015
ghenv.Component.AdditionalHelpFromDocStrings = "2"

import rhinoscriptsyntax as rs
import Rhino as rc
import scriptcontext as sc
import os
import System
import Grasshopper.Kernel as gh
import uuid

tolerance = sc.doc.ModelAbsoluteTolerance
import math


def main(shdSurfaces, EPTransSchedule, meshingSettings, justBoundingBox):
    
    # import the classes
    if sc.sticky.has_key('honeybee_release'):

        try:
            if not sc.sticky['honeybee_release'].isCompatible(ghenv.Component): return -1
            if sc.sticky['honeybee_release'].isInputMissing(ghenv.Component): return -1
        except:
            warning = "You need a newer version of Honeybee to use this compoent." + \
            " Use updateHoneybee component to update userObjects.\n" + \
            "If you have already updated userObjects drag Honeybee_Honeybee component " + \
            "into canvas and try again."
            w = gh.GH_RuntimeMessageLevel.Warning
            ghenv.Component.AddRuntimeMessage(w, warning)
            return -1
        
        # don't customize this part
        hb_EPSrf = sc.sticky["honeybee_EPSurface"]
        hb_EPSHDSurface = sc.sticky["honeybee_EPShdSurface"]
        hb_RADMaterialAUX = sc.sticky["honeybee_RADMaterialAUX"]
        hb_EPObjectsAux = sc.sticky["honeybee_EPObjectsAUX"]()
        HBScheduleList = sc.sticky["honeybee_ScheduleLib"].keys()

        ########################################################################
        #----------------------------------------------------------------------#
        shdBreps = []
        # create bounding box of shading geometries
        if justBoundingBox:
            for brep in shdSurfaces:
                if brep.Faces.Count>1 or not brep.Faces[0].IsPlanar(sc.doc.ModelAbsoluteTolerance):
                    shdBreps.append(brep.GetBoundingBox(True).ToBrep())
                else:
                    shdBreps.append(brep)
        else:
            shdBreps = shdSurfaces
        
        shadingClasses = []
        shadingMeshPreview = []
        
        if meshingSettings == None:
            mp = rc.Geometry.MeshingParameters.Minimal
            mp.SimplePlanes = True
        else:
            mp = meshingSettings
        
        def getRadMaterialName(radMaterial):
            nameStr = radMaterial.split(" ")[2]
            name =  nameStr.split("\n")[0]
            return name
        
        for brepCount, brep in enumerate(shdBreps):
            if brep != None:
                isPlanar = True
                # check planarity
                for face in brep.Faces:
                    if not face.IsPlanar(tolerance):
                        isPlanar = False
                        break
                
                shadingBreps = []
                if not isPlanar:
                    meshArray = rc.Geometry.Mesh.CreateFromBrep(brep, mp)
                    for mesh in meshArray:
                        for meshFace in range(mesh.Faces.Count):
                            vertices = list(mesh.Faces.GetFaceVertices(meshFace))[1:]
                            vertices = vertices + [sc.doc.ModelAbsoluteTolerance]
                            # create the brep from mesh
                            shdBrep = rc.Geometry.Brep.CreateFromCornerPoints(*vertices)
                            shadingBreps.append(shdBrep)
                else:
                    for face in brep.Faces:
                        shadingBreps.append(face.DuplicateFace(False))
                
                for faceCount, shdBrep in enumerate(shadingBreps):
                        thisShading = hb_EPSHDSurface(shdBrep, 1000*brepCount + faceCount, 'shdSrf_' + `brepCount` + '_' + `faceCount` + "_" + str(uuid.uuid4()))
                        
                        # add transmittance schedule if any
                        if EPTransSchedule!=None:
                            schedule= EPTransSchedule.upper()
                            if schedule!=None and not schedule.lower().endswith(".csv") and schedule not in HBScheduleList:
                                msg = "Cannot find " + schedule + " in Honeybee schedule library."
                                print msg
                                ghenv.Component.AddRuntimeMessage(gh.GH_RuntimeMessageLevel.Warning, msg)
                                return -1
                            elif schedule!=None and schedule.lower().endswith(".csv"):
                                # check if csv file is existed
                                if not os.path.isfile(schedule):
                                    msg = "Cannot find the shchedule file: " + schedule
                                    print msg
                                    ghenv.Component.AddRuntimeMessage(gh.GH_RuntimeMessageLevel.Warning, msg)
                                    return -1
                            
                            thisShading.TransmittanceSCH = schedule
                        
                        # add the Rad Material if any
                        if RADMaterial!=None:
                            # if it is just the name of the material make sure it is already defined
                            if len(RADMaterial.split(" ")) == 1:
                                # if the material is not in the library add it to the library
                                if not hb_RADMaterialAUX.isMatrialExistInLibrary(RADMaterial):
                                    warningMsg = "Can't find " + RADMaterial + " in RAD Material Library.\n" + \
                                                "Add the material to the library and try again."
                                    ghenv.Component.AddRuntimeMessage(gh.GH_RuntimeMessageLevel.Warning, warningMsg)
                                    return
                                
                                try:
                                    thisShading.setRADMaterial(RADMaterial)
                                except Exception, e:
                                    print e
                                    warningMsg = "You are using an old version of Honeybee_Honeybee! Update your files and try again."
                                    print warningMsg
                                    ghenv.Component.AddRuntimeMessage(gh.GH_RuntimeMessageLevel.Warning, warningMsg)
                                    return
                                
                                addedToLib = True
                            else:
                                
                                # try to add the material to the library
                                addedToLib, thisShading.RadMaterial = hb_RADMaterialAUX.analyseRadMaterials(RADMaterial, True)
                                
                            if addedToLib==False:
                                warningMsg = "Failed to add " + RADMaterial + " to the Library."
                                ghenv.Component.AddRuntimeMessage(gh.GH_RuntimeMessageLevel.Warning, warningMsg)
                                return
                        
                        # add shading to the list
                        shadingClasses.append(thisShading)
                
        # add to the hive
        hb_hive = sc.sticky["honeybee_Hive"]()
        HBContext  = hb_hive.addToHoneybeeHive(shadingClasses, ghenv.Component)
        return HBContext
        ################################################################################################
    else:
        print "You should first let Honeybee to fly..."
        w = gh.GH_RuntimeMessageLevel.Warning
        ghenv.Component.AddRuntimeMessage(w, "You should first let Honeybee to fly...")
        return -1
        

if _shdSurfaces and _shdSurfaces[0]!=None:
    # add cleaning function
    result= main(_shdSurfaces, EPTransSchedule_, meshingSettings_, justBoundingBox_)
    
    if result != -1: HBContext = result
# ---------- end hb_epcontextsrf ----------
hbsurface_13 = HoneybeePlus_HoneybeeSurface(geo=cluster_34.surfaces_2, names=cluster_34.surfacenames_2, type="6", rad_mat=radglassmat)  # -> report, flatten(HB_srf); plug-in component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
hbcontextsrfs_energyplus = Data(flatten(hb_epcontextsrf))
hb_srfs_radiance_13 = Data(flatten(hbsurface_13.HB_srf))

python_14 = GhPythonScript(Refresh=refreshall, MaterialPanel=material_13)  # -> LayerName, Roughness, Thickness, Conductivity, Density, SpecificHeat, ThermalAbsorptivity, SolarAbsorptivity, Porosity; inputs Refresh: Boolean, MaterialPanel: list; same code as python
constantschedule_2 = Honeybee_ConstantSchedule(value=python_14.Porosity, scheduleName=python_14.LayerName)  # -> readMe, schedule, weekSched, schedIDFText; plug-in component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
radglassmaterial_2 = Honeybee_RadianceGlassMaterial(
    materialName=python_14.LayerName,
    RTransmittance=python_14.Porosity,
    GTransmittance=python_14.Porosity,
    BTransmittance=python_14.Porosity,
    refractiveIndex=1.52)  # -> avrgTrans, RADMaterial; plug-in component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
cluster_35 = Cluster(toplayer=toplayer, layername=python_14.LayerName)  # -> surfaces_2, surfacenames_2
radglassmat_2 = HoneybeePlus_RadianceGlassMaterial(name=python_14.LayerName, t_vis=python_14.Porosity)  # -> material; plug-in component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
hb_epcontextsrf_2 = HoneybeeEPContextSurfaces(
    shdSurfaces=flatten(cluster_35.surfaces_2),
    EPTransSchedule=constantschedule_2.schedule,
    RADMaterial=radglassmaterial_2.RADMaterial)  # -> HBContext; inputs shdSurfaces: list of Brep, justBoundingBox: Boolean; same code as hb_epcontextsrf
hbsurface_14 = HoneybeePlus_HoneybeeSurface(geo=cluster_35.surfaces_2, names=cluster_35.surfacenames_2, type="6", rad_mat=radglassmat_2)  # -> report, flatten(HB_srf); plug-in component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
hbcontextsrfs_energyplus_2 = Data(flatten(hb_epcontextsrf_2))
hb_srfs_radiance_14 = Data(flatten(hbsurface_14.HB_srf))

python_15 = GhPythonScript(Refresh=refreshall, MaterialPanel=material_14)  # -> LayerName, Roughness, Thickness, Conductivity, Density, SpecificHeat, ThermalAbsorptivity, SolarAbsorptivity, Porosity; inputs Refresh: Boolean, MaterialPanel: list; same code as python
constantschedule_3 = Honeybee_ConstantSchedule(value=python_15.Porosity, scheduleName=python_15.LayerName)  # -> readMe, schedule, weekSched, schedIDFText; plug-in component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
radglassmaterial_3 = Honeybee_RadianceGlassMaterial(
    materialName=python_15.LayerName,
    RTransmittance=python_15.Porosity,
    GTransmittance=python_15.Porosity,
    BTransmittance=python_15.Porosity,
    refractiveIndex=1.52)  # -> avrgTrans, RADMaterial; plug-in component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
cluster_36 = Cluster(toplayer=toplayer, layername=python_15.LayerName)  # -> surfaces_2, surfacenames_2
radglassmat_3 = HoneybeePlus_RadianceGlassMaterial(name=python_15.LayerName, t_vis=python_15.Porosity)  # -> material; plug-in component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
hb_epcontextsrf_3 = HoneybeeEPContextSurfaces(
    shdSurfaces=flatten(cluster_36.surfaces_2),
    EPTransSchedule=constantschedule_3.schedule,
    RADMaterial=radglassmaterial_3.RADMaterial)  # -> HBContext; inputs shdSurfaces: list of Brep, justBoundingBox: Boolean; same code as hb_epcontextsrf
hbsurface_15 = HoneybeePlus_HoneybeeSurface(geo=cluster_36.surfaces_2, names=cluster_36.surfacenames_2, type="6", rad_mat=radglassmat_3)  # -> report, flatten(HB_srf); plug-in component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
hbcontextsrfs_energyplus_3 = Data(flatten(hb_epcontextsrf_3))
hb_srfs_radiance_15 = Data(flatten(hbsurface_15.HB_srf))

# ----
ghpython_script = GhPythonScript(refesh=refreshall, casename=toplayer)  # -> casename; inputs refesh: Boolean
# ---------- ghpython_script: Python ----------
casename = _casename
# ---------- end ghpython_script ----------

# ---- group: ANALYSIS POINTS
concat_2 = Concatenate(FragmentA=ghpython_script, FragmentC="::", FragmentB="ANALYSIS_REGION")
concat_3 = Concatenate(FragmentA=ghpython_script, FragmentC="::", FragmentB="ANALYSIS_PLANE")
dpipeline = DynamicGeometryPipeline(
    LayerFilter=concat_2,
    TypeFilter="Brep",
    NameFilter="*",
    GroupByLayer=False,
    GroupByType=False,
    IncludeHidden=True,
    IncludeLocked=True,
    enableFullPath=True,
    listenToAttributes=True)  # -> simplify(GeometryOut)
dpipeline_2 = DynamicGeometryPipeline(
    LayerFilter=concat_3,
    TypeFilter="Brep",
    NameFilter="*",
    GroupByLayer=False,
    GroupByType=False,
    IncludeHidden=True,
    IncludeLocked=True,
    enableFullPath=True,
    listenToAttributes=True)  # -> simplify(GeometryOut)
edges = BrepEdges(Brep=dpipeline)  # -> Naked, Interior, NonManifold
Z = UnitZ(Factor="100")
move = Move(Geometry=dpipeline, Motion=Z)  # -> Geometry, Transform
join = JoinCurves(Curves=edges.Naked, Preserve=False)
cp = ControlPoints(Curve=join)  # -> flatten(Points), Weights, Knots
genpts = LBGeneratePointGrid(geometry=move.Geometry, grid_size="1", dist_surface="0")  # -> points, vectors, face_areas, mesh; plug-in component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
lng_2 = ListLength(List=cp.Points)
subtraction = Subtraction(A=lng_2, B="1")
project = ProjectPoint(Point=genpts.points, Direction=Vector(0, 0, -1), Geometry=dpipeline_2)  # -> Point, Index
split = SplitList(List=cp.Points, Index=subtraction)  # -> ListA, ListB
analysisregionboundaryvertices = Point(flatten(split.ListA))
analysispoints = Point(flatten(project.Point))

# ----
panel = Panel(honeybee)

# ---- group: ANALYSIS POINT GROUND REFLECTIVITIES
entwine_reflectivities = Entwine(
    Branch00=reflectivity,
    Branch01=reflectivity_5,
    Branch02=reflectivity_10,
    Branch03=reflectivity_4,
    Branch04=reflectivity_7,
    Branch05=reflectivity_6,
    Branch06=reflectivity_8,
    Branch07=reflectivity_9,
    Branch08=reflectivity_3,
    Branch09=reflectivity_2,
    FlattenInputs=True)  # -> simplify(Result)
entwine_boundaries = Entwine(
    Branch00=boundaries,
    Branch01=boundaries_5,
    Branch02=boundaries_10,
    Branch03=boundaries_4,
    Branch04=boundaries_7,
    Branch05=boundaries_6,
    Branch06=boundaries_8,
    Branch07=boundaries_9,
    Branch08=boundaries_3,
    Branch09=boundaries_2,
    FlattenInputs=True)  # -> simplify(Result)
null = NullItem(Item=entwine_boundaries)  # -> NullFlags, InvalidFlags, Description
toggle = BooleanToggle(True)
ma = MassAddition(Input=null.InvalidFlags)  # -> flatten(Result), PartialResults
cull = CullPattern(List=entwine_boundaries, CullPattern=invert(null.InvalidFlags))
equals = Equality(FirstNumber="0", SecondNumber=ma.Result)  # -> Equality, Inequality
clean = CleanTree(RemoveNulls=toggle, RemoveInvalid=toggle, RemoveEmpty=toggle, Tree=cull)
dispatch = Dispatch(List=flatten(entwine_reflectivities), DispatchPattern=equals.Equality)  # -> ListA, ListB
project_2 = Project(Geometry=clean, Plane=PlaneXY(0, 0, 0))  # -> Geometry, Transform
incurve = PointInCurve(Point=analysispoints, Curve=graft(project_2.Geometry))  # -> simplify(Relationship), Point
lng_3 = ListLength(List=project_2.Geometry)  # -> flatten(Length)
dup = DuplicateData(Data=graft(dispatch.ListA), Number=graft(lng_3), Order=True)  # -> flatten(Data)
larger = LargerThan(FirstNumber=incurve.Relationship, SecondNumber="1")  # -> LargerThan, OrEqualTo
dispatch_2 = Dispatch(List=analysispoints, DispatchPattern=larger.OrEqualTo)  # -> simplify(ListA), ListB
lng_4 = ListLength(List=simplify(dispatch_2.ListA))
dup_2 = DuplicateData(Data=simplify(graft(dup)), Number=simplify(graft(lng_4)), Order=True)
point_ground_reflectivities = Data(flatten(dup_2))
analysispoints_2 = Point(flatten(dispatch_2.ListA))

# ---- group: COMBINE GEOMETRIES
merge_groundhbsurfaces = Merge(
    Data1=hbsrfs_energyplus_2,
    Data2=hbsrfs_energyplus_6,
    Data3=hbsrfs_energyplus_11,
    Data4=hbsrfs_energyplus_8,
    Data5=hbsrfs_energyplus,
    Data6=hbsrfs_energyplus_5,
    Data7=hbsrfs_energyplus_7,
    Data8=hbsrfs_energyplus_9,
    Data9=hbsrfs_energyplus_10,
    Data10=hbsrfs_energyplus_4,
    Data11=hbsrfs_energyplus_3)  # -> flatten(Result)
merge_hb_srfs = Merge(
    Data1=hb_srfs_radiance,
    Data2=hb_srfs_radiance_3,
    Data3=hb_srfs_radiance_7,
    Data4=hb_srfs_radiance_12,
    Data5=hb_srfs_radiance_9,
    Data6=hb_srfs_radiance_15,
    Data7=hb_srfs_radiance_14,
    Data8=hb_srfs_radiance_2,
    Data9=hb_srfs_radiance_6,
    Data10=hb_srfs_radiance_8,
    Data11=hb_srfs_radiance_10,
    Data12=hb_srfs_radiance_11,
    Data14=hb_srfs_radiance_13,
    Data15=hb_srfs_radiance_5,
    Data16=hb_srfs_radiance_4)  # -> flatten(Result)
merge_hbcontext = Merge(Data1=hbcontextsrfs_energyplus_3, Data2=hbcontextsrfs_energyplus_2, Data4=hbcontextsrfs_energyplus)  # -> flatten(Result)
toggle_2 = BooleanToggle(True)
toggle_3 = BooleanToggle(True)
toggle_4 = BooleanToggle(True)
clean_2 = CleanTree(RemoveNulls=toggle_2, RemoveInvalid=toggle_2, RemoveEmpty=toggle_2, Tree=merge_hb_srfs)
clean_3 = CleanTree(RemoveNulls=toggle_4, RemoveInvalid=toggle_4, RemoveEmpty=toggle_4, Tree=merge_hbcontext)
clean_4 = CleanTree(RemoveNulls=toggle_3, RemoveInvalid=toggle_3, RemoveEmpty=toggle_3, Tree=merge_groundhbsurfaces)
createhbzones = Honeybee_createHBZones(name="GROUND_ZONE", HBSurfaces=flatten(clean_4), isConditioned=Toggle(False))  # -> readMe, HBZone; plug-in component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
merge_hbzones = Merge(Data1=hbzones_energyplus, Data2=createhbzones.HBZone)  # -> flatten(Result)
toggle_5 = BooleanToggle(True)
clean_5 = CleanTree(RemoveNulls=toggle_5, RemoveInvalid=toggle_5, RemoveEmpty=toggle_5, Tree=merge_hbzones)
hbzones = Data(flatten(clean_5))
hbcontext = Data(flatten(clean_3))
hb_srfs = Data(flatten(clean_2))

# ----
number_slider = Slider(0.03, range=0.01..0.2)  # disabled
debrep_2 = DeconstructBrep(Brep=clean_4)  # -> Faces, Edges, simplify(Vertices); disabled
pt = Point(debrep_2.Vertices)  # disabled
cullpt = CullDuplicates(Points=debrep_2.Vertices, Tolerance=number_slider, CullMode=1)  # -> Points, Indices, Valence; disabled
lng_5 = ListLength(List=debrep_2.Vertices)  # disabled
lng_6 = ListLength(List=cullpt.Valence)  # disabled
subtraction_2 = Subtraction(A=lng_5, B=lng_6)  # -> flatten(Result); disabled
panel_2 = Panel("0")  # disabled
equals_2 = Equality(FirstNumber=panel_2, SecondNumber=subtraction_2)  # -> Equality, Inequality; disabled
dispatch_3 = Dispatch(List=clean_4, DispatchPattern=equals_2.Equality)  # -> ListA, ListB; disabled
data = Data(dispatch_3.ListB)  # disabled
debrep_3 = DeconstructBrep(Brep=hbzones)  # -> flatten(Faces), Edges, Vertices; disabled
debrep_4 = DeconstructBrep(Brep=hbcontext)  # -> flatten(Faces), Edges, Vertices; disabled
lng_7 = ListLength(List=debrep_3.Faces)  # disabled
# TODO -
# add check here for donut faces!
lng_8 = ListLength(List=debrep_4.Faces)  # disabled
addition = Addition(A=lng_7, B=lng_8)  # disabled

toggle_6 = BooleanToggle(True)
runradiancefilegeneration = Boolean(toggle_6)
runeplusfilegeneration = Boolean(toggle_6)

# ---- group: Generate EnergyPlus surface temperature model
toggle_7 = BooleanToggle(False)
simcontrol = Honeybee_SimulationControl(
    doZoneSizingCalculation=toggle_7,
    doSystemSizingCalculation=toggle_7,
    doPlantSizingCalculation=toggle_7,
    runSimForSizingPeriods=toggle_7,
    runSimForRunPeriods=Toggle(True))  # -> simControls; plug-in component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
importgroundtemp = Ladybug_ImportGroundTemp(epwFile=weatherfile)  # -> readMe, groundtemp1st, groundtemp2nd, groundtemp3rd, profileCrvs, crvColors, graphAxes, graphtext, Legend; plug-in component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
shadowpar = Honeybee_ShadowPar(calculationMethod="TimestepFrequency", frequency="1", maximumFigure="1000")  # -> shadowPar; plug-in component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
panel_3 = Panel("""OutputControl:Table:Style,Comma;
Output:Variable,*,Surface Outside Face Temperature, hourly;
Output:Diagnostics,DisplayExtraWarnings;""")
strnum = Ladybug_SeparateData(inputList=flatten(importgroundtemp.groundtemp1st))  # -> numbers, strings; plug-in component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
energysimpar = Honeybee_EnergySimulationPar(
    timestep=6,
    shadowCalcPar=shadowpar,
    solarDistribution="3",
    simulationControls=simcontrol,
    terrain="0",
    monthlyGrndTemps=strnum.numbers)  # -> energySimPar; plug-in component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
exporttoopenstudio = Honeybee_ExportToOpenStudio(
    epwWeatherFile=weatherfile,
    energySimPar=energysimpar,
    HBZones=flatten(hbzones),
    HBContext=flatten(hbcontext),
    simulationOutputs=flatten(panel_3),
    writeOSM=runeplusfilegeneration,
    runSimulation="3",
    fileName=toplayer,
    workingDir=output_directory)  # -> readMe, osmFileAddress, idfFileAddress, resultFileAddress, eioFileAddress, rddFileAddress, htmlReport, studyFolder, model; plug-in component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
modifygrass_underground = GhPythonScript(originalFile=exporttoopenstudio.idfFileAddress, rewrite=Toggle(True))  # -> idfAddress; inputs rewrite: Boolean
# ---------- modifygrass_underground: Python ----------
import os, re

# Read original file
with open(_originalFile, "r") as f:
    data = f.read()

# Replace whitespace between values and comments
test = re.sub("\s+!", "!", data)

# Replace grass material
test = re.sub(
    "Material,\n  GND_GRASS,!- Name\n  Rough,!- Roughness\n  0.2,!- Thickness {m}\n  1,!- Conductivity {W/m-K}\n  1250,!- Density {kg/m3}\n  1252,!- Specific Heat {J/kg-K}\n  0.92,!- Thermal Absorptance\n  0.75,!- Solar Absorptance\n  0.7;!- Visible Absorptance", 
    "Material:RoofVegetation,\n  GND_GRASS,!- Name\n  0.05,!- Height of Plants\n  1.71,!- Leaf Area Index\n  0.19,!- Leaf Reflectivity\n  0.95,!- Leaf Emissivity\n  180,!- Minimum Stomatal Resistance\n  Soil,!- Soil Layer Name\n  Rough,!- Roughness\n  0.2,!- Thickness\n  1,!- Conductivity of Dry Soil\n  1250,!- Density of Dry Soil\n  1252,!- Specific Heat of Dry Soil\n  0.92,!- Thermal Absorptance\n  0.75,!- Solar Absorptance\n  0.75,!- Visible Absorptance\n  0.3,!- Saturation Volumetric Moisture Content of the Soil Layer\n  0.01,!- Residual Volumetric Moisture Content of the Soil Layer\n  0.1,!- Initial Volumetric Moisture Content of the Soil Layer\n  Simple;!- Moisture Diffusion Calculation Method", 
    test
)

# Replace grass material
test = re.sub(
    "Material,\n  GND_VEGETATION,!- Name\n  Rough,!- Roughness\n  0.2,!- Thickness {m}\n  1,!- Conductivity {W/m-K}\n  1250,!- Density {kg/m3}\n  1252,!- Specific Heat {J/kg-K}\n  0.92,!- Thermal Absorptance\n  0.75,!- Solar Absorptance\n  0.7;!- Visible Absorptance", 
    "Material:RoofVegetation,\n  GND_VEGETATION,!- Name\n  0.25,!- Height of Plants\n  2.08,!- Leaf Area Index\n  0.21,!- Leaf Reflectivity\n  0.95,!- Leaf Emissivity\n  180,!- Minimum Stomatal Resistance\n  Soil,!- Soil Layer Name\n  Rough,!- Roughness\n  0.2,!- Thickness\n  0.5,!- Conductivity of Dry Soil\n  1600,!- Density of Dry Soil\n  1026,!- Specific Heat of Dry Soil\n  0.9,!- Thermal Absorptance\n  0.7,!- Solar Absorptance\n  0.7,!- Visible Absorptance\n  0.3,!- Saturation Volumetric Moisture Content of the Soil Layer\n  0.01,!- Residual Volumetric Moisture Content of the Soil Layer\n  0.1,!- Initial Volumetric Moisture Content of the Soil Layer\n  Simple;!- Moisture Diffusion Calculation Method", 
    test
)

# Make underground surfaces ground-adjacent
test = re.sub(
    "  GND_SURROUNDING,!- Construction Name\n  GROUND_ZONE,!- Zone Name\n  Outdoors,!- Outside Boundary Condition\n  ,!- Outside Boundary Condition Object\n  Nosun,!- Sun Exposure\n  Nowind,!- Wind Exposure", 
    "  GND_SURROUNDING,!- Construction Name\n  GROUND_ZONE,!- Zone Name\n  Ground,!- Outside Boundary Condition\n  ,!- Outside Boundary Condition Object\n  Nosun,!- Sun Exposure\n  Nowind,!- Wind Exposure", 
    test
)
test = re.sub(
    "  GND_SURROUNDING,!- Construction Name\n  GROUND_ZONE,!- Zone Name\n  Outdoors,!- Outside Boundary Condition\n  ,!- Outside Boundary Condition Object\n  Sunexposed,!- Sun Exposure\n  Windexposed,!- Wind Exposure", 
    "  GND_SURROUNDING,!- Construction Name\n  GROUND_ZONE,!- Zone Name\n  Ground,!- Outside Boundary Condition\n  ,!- Outside Boundary Condition Object\n  Nosun,!- Sun Exposure\n  Nowind,!- Wind Exposure", 
    test
)

# Rewrite the IDF file
if _rewrite:
    with open(_originalFile, "w") as f:
        f.write(test)
    idfAddress = _originalFile
# ---------- end modifygrass_underground ----------
createbat = GhPythonScript(epwPath=weatherfile, eplusPath=e_executable_path, idfPath=modifygrass_underground)  # -> command
# ---------- createbat: Python ----------
import rhinoscriptsyntax as rs
import os, json

# Create EnergyPlus run command
#idf_path = os.path.join(_outputDir, _caseName, "OpenStudio", _caseName, "ModelToIdf", "in.idf").replace("\\", "/")
#idf_output_dir = os.path.join(_outputDir, _caseName, "OpenStudio", _caseName, "ModelToIdf").replace("\\", "/")
#eplus_output_path = os.path.join(_outputDir, _caseName, "OpenStudio", _caseName, "ModelToIdf", "eplusout.csv").replace("\\", "/")
#eplus_command = '"{0:}" -a -r -x -d "{3:}" -w "{1:}" "{2:}"'.format(_eplusPath.replace("\\", "/"), _epwFile, idf_path, idf_output_dir)

# Base path for batch file
bat_dir = os.path.dirname(os.path.dirname(os.path.dirname(os.path.dirname(_idfPath))))
_batPath = os.path.join(bat_dir, "run_eplus.bat")

# Output directory for eplus run
eplus_out_dir = os.path.dirname(_idfPath)

# Command string to write to BAT
eplus_command = '"{0:}" -a -r -x -d "{3:}" -w "{1:}" "{2:}"'.format(_eplusPath, _epwPath, _idfPath, eplus_out_dir).replace("\\", "/")

# Write BAT file
with open(_batPath, "w") as f:
    f.write(eplus_command)

command = eplus_command
# ---------- end createbat ----------

# ----
tree_canopy_density = Slider(140, range=100..500)  # disabled
leaf_size = Panel("0.65")  # disabled
treeclosedpolysurfs = Brep([<brep referenced from the Rhino model> x26])  # disabled
bbox = BoundingBox(Content=treeclosedpolysurfs, Plane=PlaneXY(0, 0, 0))  # -> Box, Box_2; disabled
debox = DeconstructBox(Box=bbox.Box)  # -> Plane, X, Y, Z; disabled
volume = Volume(Geometry=treeclosedpolysurfs)  # -> Volume, Centroid; disabled
dedomain = DeconstructDomain(Domain=debox.X)  # -> Start, End; disabled
dedomain_2 = DeconstructDomain(Domain=debox.Y)  # -> Start, End; disabled
dedomain_3 = DeconstructDomain(Domain=debox.Z)  # -> Start, End; disabled
subtraction_3 = Subtraction(A=dedomain.End, B=dedomain.Start)  # disabled
subtraction_4 = Subtraction(A=dedomain_2.End, B=dedomain_2.Start)  # disabled
subtraction_5 = Subtraction(A=dedomain_3.End, B=dedomain_3.Start)  # disabled
consvolbox = ConstrainedVolumeBox(Plane=volume.Centroid, Volume=volume.Volume, FactorX=subtraction_3, FactorY=subtraction_4, FactorZ=subtraction_5)  # -> Box, DimensionX, DimensionY, DimensionZ; disabled
panel_4 = Panel("0 to 100")  # disabled
lng_9 = ListLength(List=treeclosedpolysurfs)  # disabled
random = Random(Range=panel_4, Number=lng_9, Seed=2)  # disabled
pop3d = Populate3D(Region=treeclosedpolysurfs, Count=tree_canopy_density, Seed=random)  # -> simplify(Population); disabled
brepinc = PointInBrep(Brep=graft(consvolbox.Box), Point=pop3d, Strict=False)  # disabled
dispatch_4 = Dispatch(List=pop3d, DispatchPattern=brepinc)  # -> simplify(ListA), ListB; disabled
pt_2 = Point(dispatch_4.ListA)  # disabled
lng_10 = ListLength(List=pt_2)  # disabled
button = Button()  # disabled
python_16 = GhPythonScript(reroll=button, n=flatten(lng_10))  # -> simplify(vectors); inputs reroll: Boolean, n: list; disabled
# ---------- python_16: Python ----------
import random

import ghpythonlib.treehelpers as th
import Rhino
import rhinoscriptsyntax as rs

# For each number of vectors, create a randomised vector
vectors = []
for i in n:
    temp = []
    for j in range(i):
        temp.append(rs.AddPoint(random.uniform(0, 1), random.uniform(0, 1), random.uniform(0, 1)))
    vectors.append(temp)

vectors = th.list_to_tree(vectors, source=[0, 0])
# ---------- end python_16 ----------
panel_5 = Panel("""0
120
240""")  # disabled
pl = PlaneNormal(Origin=pt_2, ZAxis=python_16)  # disabled
rad = Radians(Degrees=panel_5)  # disabled
prot = RotatePlane(Plane=graft(pl), Angle=rad)  # disabled
toggle_8 = BooleanToggle(True)  # disabled
pt_3 = PointOriented(BasePlane=prot, UComponent=leaf_size, VComponent=0, WComponent=0)  # disabled
pline = PolyLine(Vertices=pt_3, Closed=toggle_8)  # disabled
mesh = MeshBrep(
    Brep=pline,
    Settings={GridMaxCount=0, GridMinCount=16, JaggedSeams=False, MaxEdgeLength=0, MinEdgeLength=0.0001, MinTolerance=0, Refine=True, RefineAngle=0, RelativeTolerance=0.65, SimplePlanes=True, Tolerance=0})  # disabled
path_mapper = PathMapper(mesh, source="{A;B}", target="{A}")  # disabled
boundary = BoundarySurfaces(Edges=pline)  # disabled
path_mapper_2 = PathMapper(boundary, source="{A;B}", target="{A}")  # disabled
mjoin = MeshJoin(Meshes=path_mapper)  # -> flatten(Mesh); disabled
preview = CustomPreview(
    Geometry=path_mapper_2,
    Material={diffuse=RGB(221, 160, 221), emission=RGB(66, 48, 66), shine=0.5, specular=RGB(255, 255, 255), transparency=0})  # disabled

# ----
# Donut surfaces - get rid o' these
edges_2 = BrepEdges(Brep=clean_4)  # -> Naked, Interior, NonManifold
join_2 = JoinCurves(Curves=edges_2.Naked, Preserve=Toggle(False))
simplify = SimplifyCurve(Curve=join_2)  # -> simplify(Curve), Simplified
lng_11 = ListLength(List=simplify.Curve)
larger_2 = LargerThan(FirstNumber=flatten(lng_11), SecondNumber="1")  # -> LargerThan, OrEqualTo
dispatch_5 = Dispatch(List=clean_4, DispatchPattern=larger_2.LargerThan)  # -> ListA, ListB
donutsurfaces = CustomPreview(Geometry=dispatch_5.ListA, Material=ColourSwatch(SwatchColor=RGB(255, 0, 0)))

# ----
# Create a grid over the analysis region - for splitting ground surfaces
analysis_region = Brep(dpipeline)  # disabled
debrep_5 = DeconstructBrep(Brep=analysis_region)  # -> Faces, Edges, Vertices; disabled
join_3 = JoinCurves(Curves=debrep_5.Edges, Preserve=False)  # disabled
area = Area(Geometry=debrep_5.Faces)  # -> Area, Centroid; disabled
panel_6 = Panel("2.5")  # disabled
evalsrf = EvaluateSurface(Surface=debrep_5.Faces, Point=area.Centroid)  # -> Point, Normal, UDirection, VDirection, Frame; disabled
offset = OffsetCurve(Curve=join_3, Distance=panel_6, Plane=PlaneXY(0, 0, 0), Corners=1)  # disabled
pl_2 = ConstructPlane(Origin=evalsrf.Point, XAxis=evalsrf.UDirection, YAxis=evalsrf.VDirection)  # disabled
bbox_2 = BoundingBox(Content=debrep_5.Faces, Plane=pl_2)  # -> Box, Box_2; disabled
panel_7 = Panel("1.2")  # disabled
number_slider_2 = Slider(14, range=1..25)  # disabled
scale = Scale(Geometry=bbox_2.Box, Center=area.Centroid, Factor=panel_7)  # -> Geometry, Transform; disabled
number_slider_3 = Slider(20, range=1..25)  # disabled
debrep_6 = DeconstructBrep(Brep=scale.Geometry)  # -> Faces, Edges, Vertices; disabled
divide = DivideDomain²(Domain=debrep_6.Faces, UCount=number_slider_3, VCount=number_slider_2)  # disabled
subsrf = Isotrim(Surface=debrep_6.Faces, Domain=divide)  # disabled
srfsplit = SurfaceSplit(Surface=subsrf, Curves=offset)  # disabled
item = ListItem(List=simplify(srfsplit), Index=0, Wrap=True)  # -> flatten(Item); disabled
area_2 = Area(Geometry=item)  # -> Area, Centroid; disabled
incurve_2 = PointInCurve(Point=area_2.Centroid, Curve=offset)  # -> Relationship, Point; disabled
panel_8 = Panel("2")  # disabled
equals_3 = Equality(FirstNumber=incurve_2.Relationship, SecondNumber=panel_8)  # -> Equality, Inequality; disabled
dispatch_6 = Dispatch(List=item, DispatchPattern=equals_3.Equality)  # -> ListA, ListB; disabled
edges_3 = BrepEdges(Brep=dispatch_6.ListA)  # -> Naked, Interior, NonManifold; disabled
join_4 = JoinCurves(Curves=edges_3.Naked, Preserve=False)  # disabled
gridcurves = Curve(flatten(join_4))  # disabled

# ---- group: CREATE RADIANCE CASE
wea = HoneybeePlus_WEAFromEPW(epw_file=weatherfile)  # -> wea; plug-in component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
analysisgrid = HoneybeePlus_AnalysisGrid(test_points=analysispoints_2)  # -> analysis_grid; plug-in component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
skymatrix = HoneybeePlus_SkyMatrix(north=0, wea=wea, density=1)  # -> skymtx; plug-in component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
annualdlrecipe = HoneybeePlus_AnnualDaylightRecipe(skymtx=skymatrix, analysis_grids=analysisgrid, analysis_type="1", reuse_dmtx=Toggle(True))  # -> analysis_recipe; plug-in component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
runradiance = HoneybeePlus_RunRadianceAnalysis(
    analysis_recipe=annualdlrecipe,
    HB_objects=hb_srfs,
    folder=output_directory,
    name=toplayer,
    write=runradiancefilegeneration)  # -> report, legend_par, outputs; plug-in component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
createbat_2 = GhPythonScript(HB_report=runradiance.report)  # -> command; inputs HB_report: list
# ---------- createbat_2: Python ----------
import os

# Base path for batch file
base_path = os.path.dirname(HB_report[3].replace("Writing recipe contents to: ", ""))
_batPath = os.path.join(base_path, "run_radiance.bat")
ref_bat_path = os.path.join(base_path, "gridbased_annual", "commands.bat")

# Write BAT file
with open(_batPath, "w") as f:
    f.write(ref_bat_path)

command = ref_bat_path
# ---------- end createbat_2 ----------

# ----
# Small area surfaces - try to avoid these
number_slider_4 = Slider(4, range=0..20)
area_3 = Area(Geometry=clean_4)  # -> Area, Centroid
series_2 = Series(Start=0, Step=1, Count=number_slider_4)
sort = SortList(Keys=area_3.Area, ValuesA=clean_4)  # -> Keys, ValuesA
item_2 = ListItem(List=sort.ValuesA, Index=series_2, Wrap=True)
area_4 = Area(Geometry=item_2)  # -> Area, Centroid
dots = DotDisplay(Point=area_4.Centroid, Colour=ColourSwatch(SwatchColor=RGB(255, 0, 0)), Size="0.5")

logicpause = GhPythonScript(x=createbat, y=createbat_2)  # -> a, b
# ---------- logicpause: Python ----------
a = 1
b = "Verdana"
# ---------- end logicpause ----------
hbzones_2 = Data(hbzones)
labelzones = Honeybee_LabelZones(HBZones=flatten(hbzones_2), attribute="name", font=logicpause.b)  # -> zoneTxtLabels, labelBasePts, brepTxtLabels, zoneWireFrames; plug-in component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
tsort = SortText(Keys=labelzones.zoneTxtLabels, Values=hbzones_2, Culture=127)  # -> Keys, Values
debrep_7 = DeconstructBrep(Brep=tsort.Values)  # -> flatten(Faces), Edges, Vertices
skypatchdensity = Panel("1")
lng_12 = ListLength(List=debrep_7.Faces)
srfviewfactors = Ladybug_SurfaceViewAnalysis(
    testPtsOrPlanes=flatten(analysispoints_2),
    testSrfs=debrep_7.Faces,
    context=hbcontext,
    viewResolution=skypatchdensity,
    parallel=Toggle(True),
    runIt=Toggle(True))  # -> readMe, srfViewFactors, viewVecSrfIndex, viewVectors, viewPatches, viewPatchBasePt; plug-in component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
shadingmask = Ladybug_ShadingMask(centerPtOrPlane=analysispoints_2, context=hbcontext, scale=logicpause.a)  # -> contextMask, orientationMask, strategyMask, skyMask, port, contextExposure, orientExposure, strategyExposure, skyExposure; plug-in component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
split_2 = SplitList(List=srfviewfactors.srfViewFactors, Index=lng_12)  # -> simplify(ListA), simplify(ListB)
surface_view_factors = Data(split_2.ListA)
ptskyexposure = Data(shadingmask.skyExposure)

toggle_9 = BooleanToggle(True)
writesurfaceviewfactors = GhPythonScript(outputDir=output_directory, caseName=toplayer, surfaceViewFactors=surface_view_factors, write=toggle_9)  # -> info; inputs surfaceViewFactors: tree, write: Boolean
# ---------- writesurfaceviewfactors: Python ----------
import os

outpath = os.path.join(_outputDir, _caseName, "_surface_view_factors.vf")

if _write:
    with open(outpath, "w") as f:
        # for each branc of tree
        for i in range(_surfaceViewFactors.BranchCount):
            # Join into string and write to file
            f.write("{}\n".format(",".join([str(j) for j in _surfaceViewFactors.Branch(i)])))
    info = "File written to {}".format(outpath)
else:
    info = "File will be written to {}".format(outpath)
# ---------- end writesurfaceviewfactors ----------
writegndreflectivity = GhPythonScript(outputDir=output_directory, caseName=toplayer, gndReflectivities=point_ground_reflectivities, write=toggle_9)  # -> info; inputs gndReflectivities: list, write: Boolean
# ---------- writegndreflectivity: Python ----------
import os

outpath = os.path.join(_outputDir, _caseName, "_ground_reflectivities.rfl")

if _write:
    with open(outpath, "w") as f:
        for refl in _gndReflectivities:
            f.write("{}\n".format(refl))
    info = "File written to {}".format(outpath)
else:
    info = "File will be written to {}".format(outpath)
# ---------- end writegndreflectivity ----------
writeboundarypts = GhPythonScript(outputDir=output_directory, caseName=toplayer, boundaryPoints=analysisregionboundaryvertices, write=toggle_9)  # -> info; inputs boundaryPoints: list of Point3d, write: Boolean
# ---------- writeboundarypts: Python ----------
import os

outpath = os.path.join(_outputDir, _caseName, "_boundary_points.xyz")

if _write:
    with open(outpath, "w") as f:
        for pt in _boundaryPoints:
            f.write("{}, {}, {}\n".format(pt.X, pt.Y, pt.Z))
    info = "File written to {}".format(outpath)
else:
    info = "File will be written to {}".format(outpath)
# ---------- end writeboundarypts ----------
writeskyviewfactors = GhPythonScript(outputDir=output_directory, caseName=toplayer, skyViewFactors=ptskyexposure, write=toggle_9)  # -> info; inputs skyViewFactors: list, write: Boolean
# ---------- writeskyviewfactors: Python ----------
import os

outpath = os.path.join(_outputDir, _caseName, "_sky_view_factors.vf")

if _write:
    with open(outpath, "w") as f:
        for svf in _skyViewFactors:
            f.write("{}\n".format(svf))
    info = "File written to {}".format(outpath)
else:
    info = "File will be written to {}".format(outpath)
# ---------- end writeskyviewfactors ----------
writesamplepts = GhPythonScript(outputDir=output_directory, caseName=toplayer, samplePoints=analysispoints_2, write=toggle_9)  # -> info; inputs samplePoints: list of Point3d, write: Boolean
# ---------- writesamplepts: Python ----------
import os

outpath = os.path.join(_outputDir, _caseName, "_sample_points.xyz")

if _write:
    with open(outpath, "w") as f:
        for pt in _samplePoints:
            f.write("{}, {}, {}\n".format(pt.X, pt.Y, pt.Z))
    info = "File written to {}".format(outpath)
else:
    info = "File will be written to {}".format(outpath)
# ---------- end writesamplepts ----------
panel_9 = Panel(writesurfaceviewfactors)
panel_10 = Panel(writeskyviewfactors)
panel_11 = Panel(writegndreflectivity)
panel_12 = Panel(writesamplepts)
panel_13 = Panel(writeboundarypts)

# ----
# OLD - TO BE REMOVED
createbat_recipe = GhPythonScript(
    epwFile=weatherfile,
    outputDir=output_directory,
    caseName=toplayer,
    samplePoints=analysispoints_2,
    boundaryPoints=analysisregionboundaryvertices,
    groundReflectivities=point_ground_reflectivities,
    skyViewFactors=ptskyexposure,
    srfViewFactors=surface_view_factors)  # inputs samplePoints: list of Point3d, boundaryPoints: list of Point3d, groundReflectivities: list, skyViewFactors: list, srfViewFactors: tree; disabled
# ---------- createbat_recipe: Python ----------
__author__ = "tgerrish"
__version__ = "2020.03.17"

import rhinoscriptsyntax as rs
import os, json

# Copy epw file to local directory
os.system('copy {0:} {1:}'.format(_epwFile, os.path.join(_outputDir, _caseName, os.path.basename(_epwFile))))

# Define Radiance result directory
radiance_result_directory = os.path.join(_outputDir, _caseName, "gridbased_annual", "result").replace("\\", "/")

# Generate the JSON recipe for processing in pure Python
d = {}

# EPW file
d["epw"] = os.path.join(_outputDir, _caseName, os.path.basename(_epwFile)).replace("\\", "/")

# Add surface view factors
d["surface_view_factors"] = [[j for j in _srfViewFactors.Branch(i)] for i in range(_srfViewFactors.BranchCount)]

# Add sky view factors
d["sky_view_factors"] = _skyViewFactors

# Add ground reflectivieis
d["ground_reflectivities"] = _groundReflectivities

# Path to radiance results
d["radiation_results"] = radiance_result_directory

# XYZ locations
d["points"] = [[i.X, i.Y, i.Z] for i in _samplePoints]

# Boundary points
d["boundary"] = [[i.X, i.Y, i.Z] for i in _boundaryPoints]

# Energyplus surface temperatures
d["eplus_results"] = os.path.join(_outputDir, _caseName, "OpenStudio", _caseName, "ModelToIdf", "eplusout.csv").replace("\\", "/")

# Output recipe
if (len(_skyViewFactors) != 0) & (_srfViewFactors.BranchCount != 0):
    output_path = os.path.join(_outputDir, _caseName, "recipe.json").replace("\\", "/")
    with open(output_path, "w") as f:
        json.dump(d, f)
# ---------- end createbat_recipe ----------

# ---- group: TESTING GROUP FOR DODGY GEOMETRY!
# TEST SPACE FOR DODGY GROUND GEOMETRY
# - Enable to check model validity!
toggle_10 = BooleanToggle(True)
toggle_11 = BooleanToggle(False)
importgroundtemp_2 = Ladybug_ImportGroundTemp(epwFile=weatherfile)  # -> readMe, groundtemp1st, groundtemp2nd, groundtemp3rd, profileCrvs, crvColors, graphAxes, graphtext, Legend; plug-in component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
simcontrol_2 = Honeybee_SimulationControl(
    doZoneSizingCalculation=toggle_11,
    doSystemSizingCalculation=toggle_11,
    doPlantSizingCalculation=toggle_11,
    runSimForSizingPeriods=toggle_11,
    runSimForRunPeriods=toggle_10)  # -> simControls; plug-in component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
shadowpar_2 = Honeybee_ShadowPar(calculationMethod="AverageOverDaysInFrequency", frequency="365", maximumFigure="200")  # -> shadowPar; plug-in component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
isconvex = Honeybee_FindNonConvex(breps=hbzones)  # -> readMe, nonConvex, faultyGeometry; plug-in component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
strnum_2 = Ladybug_SeparateData(inputList=flatten(importgroundtemp_2.groundtemp1st))  # -> numbers, strings; plug-in component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
panel_14 = Panel("""OutputControl:Table:Style,Comma;
Output:Variable,*,Site Outdoor Air Drybulb Temperature, hourly;
Output:Diagnostics,DisplayExtraWarnings;""")
panel_15 = Panel("Output:Diagnostics,DisplayExtraWarnings;")
energysimpar_2 = Honeybee_EnergySimulationPar(
    timestep="4",
    shadowCalcPar=shadowpar_2,
    solarDistribution="0",
    simulationControls=simcontrol_2,
    terrain="0",
    monthlyGrndTemps=strnum_2.numbers)  # -> energySimPar; plug-in component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
analysisperiod = Ladybug_AnalysisPeriod(fromMonth="5", fromDay="12", toMonth="5", toDay="19")  # -> readMe, analysisPeriod; plug-in component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
toggle_12 = BooleanToggle(True)

# ----
preview_2 = CustomPreview(
    Geometry=isconvex.faultyGeometry,
    Material={diffuse=RGB(221, 160, 221), emission=RGB(66, 48, 66), shine=0.5, specular=RGB(255, 255, 255), transparency=0})
exporttoopenstudio_2 = Honeybee_ExportToOpenStudio(
    epwWeatherFile=weatherfile,
    analysisPeriod=analysisperiod.analysisPeriod,
    energySimPar=energysimpar_2,
    HBZones=flatten(hbzones),
    HBContext=flatten(hbcontext),
    simulationOutputs=flatten(panel_14),
    additionalStrings=flatten(panel_15),
    writeOSM=toggle_12,
    runSimulation=toggle_12)  # -> readMe, osmFileAddress, idfFileAddress, resultFileAddress, eioFileAddress, rddFileAddress, htmlReport, studyFolder, model; disabled; plug-in component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

# ---- group: TESTING GROUP FOR DODGY GEOMETRY! (continued)
finddodgyvertices = GhPythonScript(readme=exporttoopenstudio_2.readMe)  # -> readmeClean, dodgyPts, closePts; inputs readme: list
# ---------- finddodgyvertices: Python ----------
import re
import rhinoscriptsyntax as rs
import scriptcontext
import copy
tol = scriptcontext.doc.ModelAbsoluteTolerance

def removeDuplicates(points):
    # Create a dictionary to keep track of the Id
    pointDict = {}
    ptList = []
    for pt in points:
        pt3d = rs.coerce3dpoint(pt)
        pointDict[pt3d] = pt
        ptList.append(pt3d)
    
    #sortList
    ptList.sort()
    ptLast = ptList[-1]
    
    for i in range(len(ptList)-2,-1,-1):
        if (abs(ptList[i][0] - ptLast[0]) < tol) and (abs(ptList[i][1] - ptLast[1])) < tol and (abs(ptList[i][2] - ptLast[2]) < tol):
            del ptList[i]
        else:
            ptLast = ptList[i]
    
    #find the the ids with the new list
    outputList = []
    for pt in ptList:
        ptId = pointDict[pt]
        outputList.append(ptId)
    
    return outputList

duplicate_points = []
dodgy_points = []
readmeClean = []
for i in _readme:
    if len(i) != 0:
        readmeClean.append(i)
        xx = re.search('(?<=\{)(.*)(?=\})', i, re.IGNORECASE)
        if xx is not None:
            xx = (map( float, xx.group(1).split(',')))
            dodgy_points.append(rs.AddPoint(xx))
        xx = re.search('(?<==\()(.*)(?=\))', i, re.IGNORECASE)
        if xx is not None:
            xx = (map( float, xx.group(1).split(',')))
            duplicate_points.append(rs.AddPoint(xx))

closePts = duplicate_points if len(duplicate_points) == 0 else removeDuplicates(duplicate_points)
dodgyPts = dodgy_points if len(dodgy_points) == 0 else removeDuplicates(dodgy_points)
# ---------- end finddodgyvertices ----------

# ----
panel_16 = Panel(exporttoopenstudio_2.idfFileAddress)  # disabled
entwine = Entwine(Branch00=finddodgyvertices.dodgyPts, Branch01=finddodgyvertices.closePts, FlattenInputs=True)  # -> simplify(Result)
dots_2 = DotDisplay(
    Point=entwine,
    Colour=graft([ColourSwatch(SwatchColor=RGB(255, 0, 0)), ColourSwatch(SwatchColor=RGB(255, 0, 251))]),
    Size="0.5")
panel_17 = Panel(finddodgyvertices.readmeClean)

# ==== cluster Cluster
layername = ClusterInput()
toplayer = ClusterInput()
layername_2 = Data(layername)
toplayer_2 = Data(toplayer)
concat = Concatenate(FragmentA=toplayer_2, FragmentC="::", FragmentB=layername_2)
dpipeline = DynamicGeometryPipeline(
    LayerFilter=concat,
    TypeFilter="Brep",
    NameFilter="*",
    GroupByLayer=False,
    GroupByType=False,
    IncludeHidden=True,
    IncludeLocked=True,
    enableFullPath=True,
    listenToAttributes=True)  # -> simplify(flatten(GeometryOut))
debrep = DeconstructBrep(Brep=dpipeline)  # -> flatten(Faces), Edges, Vertices
lng = ListLength(List=debrep.Faces)
series = Series(Start=0, Step=1, Count=lng)
concat_2 = Concatenate(FragmentA=layername_2, FragmentB=series)
surfacenames = Data(concat_2)
surfaces = Surface(debrep.Faces)
surfacenames_2 = ClusterOutput(surfacenames)
surfaces_2 = ClusterOutput(surfaces)

# ==== cluster Cluster_2
surfaces = ClusterInput()
surfaces_2 = Surface(surfaces)
project = Project(Geometry=surfaces_2, Plane=PlaneXY(0, 0, 0))  # -> Geometry, Transform
area = Area(Geometry=project.Geometry)  # -> Area, Centroid
smaller = SmallerThan(FirstNumber=area.Area, SecondNumber="0.0001")  # -> SmallerThan, OrEqualTo
dispatch = Dispatch(List=surfaces_2, DispatchPattern=smaller.SmallerThan)  # -> ListA, ListB
edges = BrepEdges(Brep=dispatch.ListB)  # -> Naked, Interior, NonManifold
join = JoinCurves(Curves=edges.Naked, Preserve=False)
explode = Explode(Curve=join, Recursive=True)  # -> Segments, simplify(Vertices)
shift = ShiftList(List=explode.Vertices, Shift=1, Wrap=False)
short = ShortestList(ListA=explode.Vertices, ListB=shift, TrimMode=2)  # -> ListA, ListB
item = ListItem(List=short.ListA, Index=0, Wrap=True)  # -> Item, Item1
item_2 = ListItem(List=short.ListB, Index=0, Wrap=True)  # -> Item, Item1
vec2pt = Vector2Pt(PointA=item.Item, PointB=item_2.Item, Unitize=False)  # -> Vector, Length
vec2pt_2 = Vector2Pt(PointA=item.Item1, PointB=item_2.Item1, Unitize=False)  # -> Vector, Length
Z = UnitZ(Factor=1)
xprod = CrossProduct(VectorA=vec2pt.Vector, VectorB=vec2pt_2.Vector, Unitize=False)  # -> Vector, Length
cset = CreateSet(List=explode.Vertices)  # -> Set, Map
dprod = DotProduct(VectorA=xprod.Vector, VectorB=Z, Unitize=True)
larger = LargerThan(FirstNumber=dprod, SecondNumber=0)  # -> LargerThan, OrEqualTo
rev = ReverseList(List=cset.Set)
cull = CullPattern(List=rev, CullPattern=invert(larger.LargerThan))
cull_2 = CullPattern(List=cset.Set, CullPattern=larger.LargerThan)
merge = Merge(Data1=cull_2, Data2=cull)
pline = PolyLine(Vertices=merge, Closed=Toggle(True))
boundaries = Data(flatten(pline))
boundaries_2 = ClusterOutput(boundaries)

# ==== cluster Cluster_3
solarabsorptivity = ClusterInput()
solarabsorptivity_2 = Data(solarabsorptivity)
subtraction = Subtraction(A="1", B=solarabsorptivity_2)
reflectivity = Data(subtraction)
reflectivity_2 = ClusterOutput(reflectivity)

# ==== cluster Cluster_4
layername = ClusterInput()
toplayer = ClusterInput()
layername_2 = Data(layername)
toplayer_2 = Data(toplayer)
concat = Concatenate(FragmentA=toplayer_2, FragmentC="::", FragmentB=layername_2)
dpipeline = DynamicGeometryPipeline(
    LayerFilter=concat,
    TypeFilter="Brep",
    NameFilter="*",
    GroupByLayer=False,
    GroupByType=False,
    IncludeHidden=True,
    IncludeLocked=True,
    enableFullPath=True,
    listenToAttributes=True)  # -> simplify(flatten(GeometryOut))
lng = ListLength(List=dpipeline)
series = Series(Start=0, Step=1, Count=lng)
concat_2 = Concatenate(FragmentA=layername_2, FragmentB=series)
brepnames = Data(concat_2)
brep = Brep(dpipeline)
brepnames_2 = ClusterOutput(brepnames)
brep_2 = ClusterOutput(brep)
