# Grasshopper definition sandbox.gh (Grasshopper 1.0.7)

pipeline = GeometryPipeline(
    GroupByLayer=False,
    GroupByType=False,
    IncludeHidden=True,
    IncludeLocked=True,
    LayerFilter="Shades",
    NameFilter="*",
    SublayerFiltering=True,
    TypeFilter=1073741848)
pipeline_2 = GeometryPipeline(
    GroupByLayer=False,
    GroupByType=False,
    IncludeHidden=True,
    IncludeLocked=True,
    LayerFilter="Ground",
    NameFilter="*",
    SublayerFiltering=True,
    TypeFilter=1073741848)
pipeline_3 = GeometryPipeline(
    GroupByLayer=False,
    GroupByType=False,
    IncludeHidden=True,
    IncludeLocked=True,
    LayerFilter="Buildings",
    NameFilter="*",
    SublayerFiltering=True,
    TypeFilter=1073741848)
# Calculate sky and surface view factors
pipeline_4 = GeometryPipeline(
    GroupByLayer=False,
    GroupByType=False,
    IncludeHidden=True,
    IncludeLocked=True,
    LayerFilter="AnalysisPlane",
    NameFilter="*",
    SublayerFiltering=True,
    TypeFilter=1073741848)
ladybug = Ladybug_Ladybug()  # -> Vviiiiiiiiiizzz; plug-in component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
bang = ExplodeTree(Data=graft(pipeline_3))  # -> Branch0, Branch1, Branch2, Branch3
data = Data([pipeline_3, pipeline_2])
data_2 = Data([bang.Branch0, bang.Branch3])
calculatedsrftempobjects = Brep(data_2)
indoorviewfactor = Honeybee_IndoorViewFactorCalculator()  # -> readMe, port, viewFactorMesh, viewFactorInfo, port_2, testPts, viewMeshFaces, zoneWireFrame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; plug-in component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
srfviewfactors = Ladybug_SurfaceViewAnalysis(viewResolution="0", parallel=Toggle(True), runIt=Toggle(True))  # -> readMe, srfViewFactors, viewVecSrfIndex, viewVectors, viewPatches, viewPatchBasePt; plug-in component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
genmesh = Ladybug_GenerateMesh(testGeometry=pipeline_4, gridSize="15", distBaseSrf="1.2", moveTestMesh=True)  # -> readMe, simplify(testPoints), simplify(ptsVectors), simplify(facesArea), simplify(mesh); plug-in component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
join = BrepJoin(Breps=calculatedsrftempobjects)  # -> Breps, Closed
pt = ConstructPoint(XCoordinate=0, YCoordinate=0, ZCoordinate="1.2")
pt_2 = ConstructPoint(XCoordinate="3", YCoordinate="3", ZCoordinate="1.2")
debrep = DeconstructBrep(Brep=join.Breps)  # -> flatten(Faces), Edges, Vertices
panel = Panel(srfviewfactors.srfViewFactors)
edges = BrepEdges(Brep=debrep.Faces)  # -> Naked, Interior, NonManifold
mesh = Mesh(flatten(debrep.Faces))
samplept = Point(genmesh.testPoints)
skyviewfactorcontext = Surface(flatten([debrep.Faces, pipeline]))
ma = MassAddition(Input=srfviewfactors.srfViewFactors)  # -> Result, PartialResults
join_2 = JoinCurves(Curves=edges.Naked, Preserve=False)  # -> flatten(Curves)

# ---- group: Create sample vectors
n_samples = Panel("5000")
fibonaccisphere_py = GhPythonScript(nPoints=n_samples, scale="10")  # -> points; inputs nPoints: Int32, anchor: Point3d
# ---------- fibonaccisphere_py: Python ----------
__author__ = "tgerrish"
__version__ = "2020.05.22"

import rhinoscriptsyntax as rs
import math

# Translation to anchor point
if anchor is None:
    anchor = rs.CreatePoint(0, 0, 0)
basePt = rs.CreatePoint(0, 0, 0)
translationVector = anchor - basePt
print(translationVector)

indices = [i + 0.5 for i in range(0, nPoints)]
phi = [math.acos(1 - 2 * i / nPoints) for i in indices]
theta = [math.pi * (1 + 5 ** 0.5) * i for i in indices]
x = [translationVector.X + ((math.cos(theta[n]) * math.sin(phi[n])) * scale) for n in range(nPoints)]
y = [translationVector.Y + ((math.sin(theta[n]) * math.sin(phi[n])) * scale) for n in range(nPoints)]
z = [translationVector.Z + ((math.cos(phi[n])) * scale) for n in range(nPoints)]

points = []
for i, j, k in list(zip(*[x, y, z])):
    points.append(rs.AddPoint([i, j, k]))

#if abs(translationVector.X) + abs(translationVector.Y) + abs(translationVector.Z) != 0:
# ---------- end fibonaccisphere_py ----------

# ----
mjoin = MeshJoin(Meshes=mesh)
line = LineSDL(Direction=srfviewfactors.viewVectors, Length="20")
cps = ClosestPoints(Point=fibonaccisphere_py, Cloud=fibonaccisphere_py, Count=3)  # -> ClosestPoint, CPIndex, Distance; disabled
item = ListItem(List=cps.Distance, Index=0, Wrap=True)  # -> Item, flatten(Item1); disabled
bnd = Bounds(Numbers=item.Item1)  # disabled
dedomain = DeconstructDomain(Domain=bnd)  # -> Start, End; disabled
samplevectors = Vector(fibonaccisphere_py)
meshray = MeshRay(Mesh=graft(mjoin), Point=graft(samplept), Direction=samplevectors)  # -> Point, Hit
meshray_2 = MeshRay(Mesh=graft(mesh), Point=graft(samplept), Direction=samplevectors)  # -> Point, Hit
gradient = Gradient(
    LowerLimit=dedomain.Start,
    UpperLimit=dedomain.End,
    Parameter=item.Item1,
    stops=[0: RGB(234, 38, 0), 0.25: RGB(234, 126, 0), 0.5: RGB(254, 244, 84), 0.75: RGB(173, 203, 249), 1: RGB(75, 107, 169)])  # disabled
cullpt = CullDuplicates(Tolerance=0.1, CullMode=3)  # -> Points, Indices, Valence
panel_2 = Panel(cps.Distance)  # disabled
meshray_3 = MeshRay(Mesh=graft(mjoin), Point=graft(samplept), Direction=samplevectors)  # -> Point, Hit

# ---- group: Split into Ground/Sky facing
pdecon = Deconstruct(Point=samplevectors)  # -> XComponent, YComponent, ZComponent
smaller = SmallerThan(FirstNumber=pdecon.ZComponent, SecondNumber="0")  # -> SmallerThan, OrEqualTo
dispatch = Dispatch(List=samplevectors, DispatchPattern=smaller.SmallerThan)  # -> ListA, ListB

# ----
toggle = BooleanToggle(True)
ivray = IsoVistRay(Radius=100)  # -> Point, Distance, Index
clean = CleanTree(RemoveNulls=toggle, RemoveInvalid=toggle, RemoveEmpty=toggle, Tree=meshray_3.Point)  # -> simplify(Tree)
fsim = FindSimilarMember(Data=clean, Set=meshray.Point)  # -> Hit, Index
panel_3 = Panel(bnd)  # disabled
dots = DotDisplay(Point=fibonaccisphere_py, Colour=gradient, Size=1)  # disabled
groundwardvectors = Vector(dispatch.ListA)
skywardvectors = Vector(dispatch.ListB)
incurve = PointInCurve(Point=graft(clean), Curve=join_2)  # -> Relationship, Point
minc = MeshInclusion(Mesh=mesh, Point=graft(clean), Strict=Toggle(False))  # -> simplify(graft(Inside))
path_mapper = PathMapper(incurve.Relationship, source="{A;B}", target="{A}")
mjoin_2 = MeshJoin(Meshes=flatten(skyviewfactorcontext))
line_2 = LineSDL(Start=samplept, Direction=skywardvectors, Length="10")
meshray_4 = MeshRay(Mesh=mjoin_2, Point=graft(samplept), Direction=skywardvectors)  # -> Point, Hit
viewer = ParamViewer(path_mapper)
path_mapper_2 = PathMapper(minc, source="{A;B;C}", target="{A;C}")
shadingmask = Ladybug_ShadingMask(centerPtOrPlane=samplept, context=skyviewfactorcontext, projection="1")  # -> contextMask, orientationMask, strategyMask, skyMask, port, contextExposure, orientExposure, strategyExposure, skyExposure; plug-in component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
equals = Equality(FirstNumber="2", SecondNumber=path_mapper)  # -> Equality, Inequality
ma_2 = MassAddition(Input=meshray_4.Hit)  # -> Result, PartialResults
lng = ListLength(List=skywardvectors)
ma_3 = MassAddition(Input=equals.Equality)  # -> Result, PartialResults
division = Division(A=ma_2.Result, B=lng)  # -> flatten(Result)
ma_4 = MassAddition(Input=path_mapper_2)  # -> Result, PartialResults
lng_2 = ListLength(List=samplevectors)
mjoin_3 = MeshJoin(Meshes=shadingmask.contextMask)
mjoin_4 = MeshJoin(Meshes=shadingmask.skyMask)
panel_4 = Panel(ma_4.Result)
area = Area(Geometry=shadingmask.contextMask)  # -> Area, Centroid
subtraction = Subtraction(A="1", B=division)
item_2 = ListItem(List=path_mapper_2, Index=0, Wrap=True)
division_2 = Division(A=ma_3.Result, B=lng_2)
area_2 = Area(Geometry=mjoin_3)  # -> Area, Centroid
area_3 = Area(Geometry=mjoin_4)  # -> Area, Centroid
recolormesh = Ladybug_RecolorMesh(analysisResult=subtraction, inputMesh=genmesh.mesh)  # -> readMe, newMesh, newLegend, legendBasePt, meshColors, legendColors; disabled; plug-in component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
panel_5 = Panel(path_mapper_2)
panel_6 = Panel(division_2)
skyviewfactor = Panel(subtraction)
addition = Addition(A=area_2.Area, B=area_3.Area)
division_3 = Division(A=area_3.Area, B=addition)
panel_7 = Panel(shadingmask.skyExposure)
panel_8 = Panel(division_3)
avr = Average(Input=subtraction)
panel_9 = Panel(avr)
